# Grasshopper definition ex2-bauhaus-2d-shapes.ghx (Grasshopper 1.0.8)
# plug-ins: RhinoCodePluginGH

show = BooleanToggle(True)
one_circle = Python3Script(show=show)  # -> circle
# ---------- one_circle: Python ----------
from compas.geometry import Circle

outline_side = 10

if show:
    #draw circle
    circle = Circle(outline_side/2)
# ---------- end one_circle ----------
transform = Python3Script(circle=one_circle)  # -> circle_mesh
# ---------- transform: Python ----------
from compas.geometry import Translation
from compas.datastructures import Mesh
from compas_rhino.conversions import circle_to_rhino, mesh_to_rhino

transform = True

#convert to compas mesh
circle_compas_mesh = (Mesh.from_polygons([circle.to_polygon(50)]))
#transform to desired location
if transform:
    circle_compas_mesh.transform(Translation.from_vector([-20,20,0]))
#convert to rhino mesh
circle_mesh = mesh_to_rhino(circle_compas_mesh)
# ---------- end transform ----------
preview = CustomPreview(Geometry=transform, Material=ColourSwatch(SwatchColor=RGB(0, 0, 255)))

show_2 = BooleanToggle(True)
star = Python3Script(show=show_2)  # -> star; inputs show: Double
# ---------- star: Python ----------
import math
from compas.geometry import Arc, Frame, Polygon

outline_side = 10
points = []
coordinates = [[-1, -1], [1, -1], [1, 1], [-1, 1]]

if show:
    start_angle = 0.0
    #draw arcs and put the points of the arc to a list
    for x, y in coordinates:
        center_frame = Frame([outline_side/2*x,outline_side/2*y,0], Frame.worldXY().xaxis, Frame.worldXY().yaxis)
        arc = Arc(radius=outline_side/2, start_angle=math.radians(start_angle), end_angle=math.radians(start_angle+90.0), frame=center_frame)
        points += arc.to_polyline(50).points[:-1]
        start_angle += 90.0
    print(len(points))
    #make a star polygon
    star = Polygon(points=points)
# ---------- end star ----------
transform_2 = Python3Script(star=star)  # -> star_mesh
# ---------- transform_2: Python ----------
import math
from compas.geometry import Translation
from compas.datastructures import Mesh
from compas_rhino.conversions import mesh_to_rhino

transform = True

#convert to compas mesh
star_compas_mesh = Mesh.from_polygons([star])
#transform the desired location
if transform:
    star_compas_mesh.transform(Translation.from_vector([-20,0,0]))
star_mesh = mesh_to_rhino(star_compas_mesh)
# ---------- end transform_2 ----------
preview_2 = CustomPreview(Geometry=transform_2, Material=ColourSwatch(SwatchColor=RGB(255, 0, 0)))

show_3 = BooleanToggle(True)
rhombus = Python3Script(show=show_3, side=Slider(4, range=3..10))  # -> rhombus; inputs side: Int32
# ---------- rhombus: Python ----------
from compas.geometry import Polygon

outline_side = 10

if show:
    #draw rhombus
    rhombus = Polygon.from_sides_and_radius_xy(n=side, radius=5)
    rhombus.point = [-5,0,0]
# ---------- end rhombus ----------
transform_3 = Python3Script(rhombus=rhombus)  # -> rhombus_mesh
# ---------- transform_3: Python ----------
from compas.geometry import Translation
from compas.datastructures import Mesh
from compas_rhino.conversions import mesh_to_rhino

transform = True

#convert to compas mesh
rhombus_compas_mesh=Mesh.from_polygons([rhombus])
#transform to desired location
if transform:
    rhombus_compas_mesh.transform(Translation.from_vector([0,-20,0]))
#convert to rhino mesh
rhombus_mesh = mesh_to_rhino(rhombus_compas_mesh)
# ---------- end transform_3 ----------
preview_3 = CustomPreview(Geometry=transform_3, Material=ColourSwatch(SwatchColor=RGB(0, 0, 255)))

show_4 = BooleanToggle(True)
checkered_squares = Python3Script(show=show_4, division=Slider(4, range=1..10))  # -> squares; inputs division: Int32
# ---------- checkered_squares: Python ----------
from compas.geometry import Circle, Polygon

outline_side = 10
square_height = outline_side/division
squares = []
square_meshes = []

if show:
    # draw squares in a grid
    for i in range(division):
        for j in range(division):
            print(i, j)
            if i % 2 == 0 and j % 2 != 0 or i % 2 != 0 and j % 2 == 0:
                x = i * square_height - outline_side/2
                y = j * square_height - outline_side/2
                square = Polygon.from_rectangle(point=[x, y, 0], width=square_height, height=square_height)
                squares.append(square)
# ---------- end checkered_squares ----------

transform_4 = Python3Script(squares=checkered_squares)  # -> square_meshes; inputs squares: list
# ---------- transform_4: Python ----------
from compas.geometry import Translation
from compas.datastructures import Mesh
from compas_rhino.conversions import circle_to_rhino, mesh_to_rhino

transform = True
square_meshes = []

#transform to desired location
for square in squares:
    square_mesh = Mesh.from_polygons([square])
    if transform:
        square_mesh.transform(Translation.from_vector([-20,-20,0]))
    square_meshes.append(mesh_to_rhino(square_mesh))
# ---------- end transform_4 ----------

preview_4 = CustomPreview(Geometry=transform_4, Material=ColourSwatch(SwatchColor=RGB(176, 140, 0)))

show_5 = BooleanToggle(True)
arc_lines = Python3Script(show=show_5, division=Slider(10, range=1..10))  # -> lines; inputs division: Int32
# ---------- arc_lines: Python ----------
import math
from compas.geometry import Arc, Line

outline_side = 10

lines = []

if show:
    #draw arc
    arc = Arc(radius=outline_side/2, start_angle=math.radians(0.0), end_angle=math.radians(90.0))
    #draw lines using its points
    for point in arc.to_polyline(n=division).points:
        line = Line([point[0],point[1],point[2]],[-point[0],-point[1],-point[2]])
        lines.append(line)
# ---------- end arc_lines ----------
linetype = ModelLinetype(<model linetype referenced from the Rhino model>)

transform_5 = Python3Script(lines=arc_lines)  # -> t_lines; inputs lines: list
# ---------- transform_5: Python ----------
import math
from compas.geometry import Translation
from compas_rhino.conversions import line_to_rhino

outline_side = 10

t_lines = []
transform = True

for line in lines:
    #transform to desired location
    if transform:
        line = line.transformed(Translation.from_vector([0,20,0]))
    t_lines.append(line_to_rhino(line))
# ---------- end transform_5 ----------

curve_preview = CustomCurvePreview(Curve=transform_5, Linetype=linetype, Colour=ColourSwatch(SwatchColor=RGB(255, 221, 53)))

show_6 = BooleanToggle(True)
concentric_circles = Python3Script(show=show_6, amount=Slider(5, range=1..10))  # -> circles; inputs amount: Int32
# ---------- concentric_circles: Python ----------
from compas.geometry import Circle

outline_side = 10

circles = []

if show:
    #draw circles until the outline
    for i in range(amount):
        radius = outline_side/2/amount
        circle = Circle((i+1)*radius)
        circles.append(circle)
# ---------- end concentric_circles ----------
linetype_2 = ModelLinetype(<model linetype referenced from the Rhino model>)

transform_6 = Python3Script(circles=concentric_circles)  # -> t_circles; inputs circles: list
# ---------- transform_6: Python ----------
from compas.geometry import Translation
from compas_rhino.conversions import circle_to_rhino
t_circles = []

transform = True

for circle in circles:
    #transform to desired location
    if transform:
        circle = circle.transformed(Translation.from_vector([0,0,0]))
    t_circles.append(circle_to_rhino(circle))
# ---------- end transform_6 ----------

curve_preview_2 = CustomCurvePreview(Curve=transform_6, Linetype=linetype_2, Colour=ColourSwatch(SwatchColor=RGB(0, 0, 0)))

show_7 = BooleanToggle(True)
concentric_arcs = Python3Script(show=show_7, amount=Slider(4, range=1..10))  # -> arcs; inputs show: Double, amount: Int32
# ---------- concentric_arcs: Python ----------
import math
from compas.geometry import Arc, Frame

outline_side = 10

arcs = []
center_frame = Frame([-outline_side/2,-outline_side/2,0], Frame.worldXY().xaxis, Frame.worldXY().yaxis)

if show:
    #draw arcs until outline
    for i in range(amount):
        radius = outline_side/amount
        arc = Arc(radius=(i+1)*radius, start_angle=math.radians(0.0), end_angle=math.radians(90.0), frame=center_frame)
        arcs.append(arc)
# ---------- end concentric_arcs ----------
linetype_3 = ModelLinetype(<model linetype referenced from the Rhino model>)

transform_7 = Python3Script(arcs=concentric_arcs)  # -> t_arcs; inputs arcs: list
# ---------- transform_7: Python ----------
import math
from compas.geometry import Translation
from compas_rhino.conversions import arc_to_rhino

t_arcs = []
transform = True

for arc in arcs:
    #transform to desired location
    if transform:
        arc = arc.transformed(Translation.from_vector([20,20,0]))
    t_arcs.append(arc_to_rhino(arc))
# ---------- end transform_7 ----------

curve_preview_3 = CustomCurvePreview(Curve=transform_7, Linetype=linetype_3, Colour=ColourSwatch(SwatchColor=RGB(255, 0, 0)))

show_8 = BooleanToggle(True)
two_half_circles = Python3Script(show=show_8)  # -> arc, arc_2; inputs show: Double
# ---------- two_half_circles: Python ----------
import math
from compas.geometry import Arc, Frame

outline_side = 10

if show:
    #draw first arc
    center_frame = Frame([0,0,0], Frame.worldXY().xaxis, Frame.worldXY().yaxis)
    arc = Arc(radius=outline_side/2, start_angle=math.radians(0.0), end_angle=math.radians(180.0), frame=center_frame)
    #draw second arc
    center_frame_2 = Frame([0,-outline_side/2,0], Frame.worldXY().xaxis, Frame.worldXY().yaxis)
    arc_2 = Arc(radius=outline_side/2, start_angle=math.radians(0.0), end_angle=math.radians(180.0), frame=center_frame_2)
# ---------- end two_half_circles ----------

transform_8 = Python3Script(arc=two_half_circles.arc, arc_2=two_half_circles.arc_2)  # -> arc_mesh, arc_mesh_2
# ---------- transform_8: Python ----------
import math
from compas.datastructures import Mesh
from compas.geometry import Polygon, Translation
from compas_rhino.conversions import mesh_to_rhino

transform = True

#convert the arcs to meshes
arc_compas_mesh = Mesh.from_polygons([Polygon(points=arc.to_polyline(n=50).points)])
arc_compas_mesh_2 = Mesh.from_polygons([Polygon(points=arc_2.to_polyline(n=50).points)])
#transform to desired location
if transform:
    arc_compas_mesh.transform(Translation.from_vector([20,0,0]))
    arc_compas_mesh_2.transform(Translation.from_vector([20,0,0]))
#convert to rhino meshes
arc_mesh = mesh_to_rhino(arc_compas_mesh)
arc_mesh_2 = mesh_to_rhino(arc_compas_mesh_2)
# ---------- end transform_8 ----------

preview_5 = CustomPreview(Geometry=transform_8.arc_mesh, Material=ColourSwatch(SwatchColor=RGB(176, 140, 0)))
preview_6 = CustomPreview(Geometry=transform_8.arc_mesh_2, Material=ColourSwatch(SwatchColor=RGB(0, 0, 0)))

show_9 = BooleanToggle(True)
straight_lines = Python3Script(show=show_9, amount=Slider(10, range=2..10))  # -> lines; inputs amount: Int32
# ---------- straight_lines: Python ----------
from compas.geometry import Line

outline_side = 10

lines = []

if show:
    #draw lines
    for i in range(amount):
        distance = outline_side/(amount-1)
        line = Line([-outline_side/2, i*distance-5, 0], [outline_side/2, i*distance-5, 0])
        lines.append(line)
# ---------- end straight_lines ----------
linetype_4 = ModelLinetype(<model linetype referenced from the Rhino model>)

transform_9 = Python3Script(lines=straight_lines)  # -> t_lines; inputs lines: list
# ---------- transform_9: Python ----------
from compas.geometry import Translation
from compas_rhino.conversions import line_to_rhino

t_lines = []
transform = True

for line in lines:
    #transform to desired location
    if transform:
        line = line.transformed(Translation.from_vector([20,-20,0]))
    #convert to rhino line
    t_lines.append(line_to_rhino(line))
# ---------- end transform_9 ----------

curve_preview_4 = CustomCurvePreview(Curve=transform_9, Linetype=linetype_4, Colour=ColourSwatch(SwatchColor=RGB(255, 0, 0)))
